# Grasshopper definition visInGH.gh (Grasshopper 1.0.7)
# plug-ins: gHowl

file_path = FilePath("E:\114_temp\008_代码集\005_java\matsim-example-project\scenarios\berlin\planGenerates.xml\planGenerates - 副本 - 副本.xml")
xml_parser = XmlParser(Path=file_path)  # -> Elements, Values, AttributeNames, AttributeValues, CData
panel = Panel(xml_parser.AttributeNames)
series = Series(Start=0, Step=1, Count=10)  # -> graft(Series)
data = Data(xml_parser.AttributeNames)
c_script = CSharpScript(x=data, y=xml_parser.AttributeValues)  # -> A, B; inputs x: tree of String, y: tree of String
# ---------- c_script: C# ----------
    DataTree<string> result = new DataTree<string>();
    int index = 0;
    B = x.Branches[0][0];
    for (int i = 0; i < x.Branches.Count; i++)
    {
      var tempBranch = x.Branches[i];
      
      if (tempBranch[0] == "type")
      {
        var tempValue = y.Branches[i];
        GH_Path path = new GH_Path(index);
        result.Add(tempValue[1], path);
        result.Add(tempValue[2], path);
        index += 1;
      }
    }
    A = result;
# ---------- end c_script ----------
tree_statistics = TreeStatistics(Tree=xml_parser.AttributeNames)  # -> Paths, Length, Count
list_length = ListLength(List=xml_parser.AttributeNames)  # -> flatten(Length)
panel_2 = Panel(xml_parser.AttributeValues)
equality = Equality(FirstNumber=list_length, SecondNumber=1)  # -> Equality, Inequality
partition_list = PartitionList(List=flatten(c_script.A), Size=6)
series_2 = Series(Start=0, Step=1, Count=10)
dispatch = Dispatch(List=tree_statistics.Paths, DispatchPattern=equality.Equality)  # -> ListA, ListB
list_item = ListItem(List=partition_list, Index=0, Wrap=True)  # -> Item, Item1
panel_3 = Panel(partition_list)
construct_point = ConstructPoint(XCoordinate=list_item.Item, YCoordinate=list_item.Item1, ZCoordinate=0)
tree_branch = TreeBranch(Tree=xml_parser.AttributeValues, Path=dispatch.ListB, MaintainPaths=True)  # -> simplify(Branch)
tree_statistics_2 = TreeStatistics(Tree=tree_branch)  # -> Paths, Length, Count
panel_4 = Panel(tree_branch)
tree_branch_2 = TreeBranch(Tree=tree_branch, MaintainPaths=True)
panel_5 = Panel(tree_branch_2)
